# Grasshopper definition 02_masonry_assembly_color_order.gh (Grasshopper 1.0.8)
# plug-ins: Frahan StonePack

M = M([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])
autoif = AutoInterfaces(Meshes=M, DistanceTolerance=0.0001, AngleToleranceDeg=1)
masasm = MasonryAssembly(Interfaces=autoif)
buildord = BlockBuildOrder(Assembly=masasm, UpVector=Vector(0, 0, 1), UpToleranceDeg=30)  # -> OrderedBlockIds, OrderedMeshes, OrderIndex, Layer
asmprev = AssemblyPreview(Assembly=masasm)  # -> FreeMeshes, FixedMeshes, FreeBlockIds, FixedBlockIds, ContactPolylines, ContactCentroids, ContactNormals, ContactPairs
