# Grasshopper definition 03_quarry_to_slabs_full.gh (Grasshopper 1.0.8)
# plug-ins: Frahan StonePack

A = A({Plane=PlaneXY(0, 0, 0), X=Domain(0, 12), Y=Domain(0, 8), Z=Domain(0, 2)})
F = F(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)
lx = Slider(0.25, range=0..1)
ly = Slider(0.25, range=0..1)
lz = Slider(0.25, range=0..1)
psistep = Slider(0.25, range=0..1)
bcosolve = BlockCutOptSolve(
    TestedArea=A,
    Fractures=F,
    BlockX=lx,
    BlockY=ly,
    BlockZ=lz,
    Kerf=0.05,
    PsiStepDeg=psistep,
    DxMax=1.5,
    DxStep=0.5,
    DyMax=1.5,
    DyStep=0.5)  # -> NonIntersectedCount, Recovery, BestPsiDeg, BestDxM, BestDyM, Evaluations, ElapsedMs
recovery = Panel(bcosolve.Recovery)
