# Grasshopper definition 04_scan_to_bench.gh (Grasshopper 1.0.8)
# plug-ins: Frahan StonePack

# README: EX 04 SCAN TO BENCH
# Cloud -> normals -> Poisson reconstruct -> bench box for block planning.
# Set the cloud path, then flip Run toggles in order.
swatch = ColourSwatch(SwatchColor=RGB(205, 170, 125))
pc = PC(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)
V = Slider(0.25, range=0..1)
k = Slider(0.25, range=0..1)
A = Slider(0.25, range=0..1)
voxeldown = VoxelDownsample(Points=pc, VoxelSize=V)  # -> Downsampled, ReductionFactor, OutputCount, Cloud
estnormals = EstimateCloudNormals(Points=voxeldown.Downsampled, KNeighbours=18, Run=False)  # -> Normals, Report, Cloud
scanrecon = ScanReconstruct(
    Points=voxeldown.Downsampled,
    Normals=estnormals.Normals,
    Mode=0,
    Alpha=A,
    PoissonDepth=8,
    SamplesPerNode=1.5,
    RadiusRatio=5,
    AFBeta=0.52,
    Run=False)  # -> Mesh, UsedMode, Report
preview = CustomPreview(Geometry=scanrecon.Mesh, Material=swatch)
benchfrommesh = BenchFromMesh(Mesh=scanrecon.Mesh, BenchHeight=0)  # -> Box, Mesh, BenchBoundary, VertexCount
vertex_count = Panel(benchfrommesh.VertexCount)
