# Grasshopper definition 11_granite_scan_to_bench.gh (Grasshopper 1.0.8)
# plug-ins: Frahan StonePack

F = F("D:\code_ws\Template-General\raw\2026-05-27\granite_dells_tls\ot_GD_TLS_data_UTM.laz")
V = V(0.5)
readlas = ReadLASCloud(FilePath=F, VoxelSize=V, Run=Toggle(True))  # -> Points, InputCount, OutputCount, BoundingBox, Cloud
estnormals = EstimateCloudNormals(Points=readlas.Points, KNeighbours=18, Run=Toggle(True))  # -> Normals, Report, Cloud
toggle = BooleanToggle(True)
scanrecon = ScanReconstruct(
    Points=flatten(readlas.Points),
    Normals=estnormals.Normals,
    Mode=Slider(2, range=0..10),
    Alpha=0,
    PoissonDepth=8,
    SamplesPerNode=1.5,
    RadiusRatio=5,
    AFBeta=0.52,
    Run=toggle)  # -> Mesh, UsedMode, Report
mesh = Mesh(scanrecon.Mesh)
Z = UnitZ(Factor=Slider(10, range=0..10))
meshfix = FrahanMeshRepair(Meshes=mesh, WeldAngle=0.3926990817, HealDistance=0.001)  # -> Repaired, Trace, Skipped, Summary
move = Move(Geometry=meshfix.Repaired, Motion=expr("-x", Z))  # -> Geometry, Transform
remeshgeogram = MeshRemeshGeogram(Mesh=mesh, Points=5000, LloydIters=5, NewtonIters=30, Run=toggle)  # -> Remeshed, Available, Report
mjoin = MeshJoin(Meshes=flatten([move.Geometry, mesh]))
demesh = DeconstructMesh(Mesh=mjoin)  # -> Vertices, Faces, Colours, Normals
hullslab = ConvexHullSlab(Mesh=flatten(mjoin))  # -> Slab, Mesh
scanrecon_2 = ScanReconstruct(
    Points=demesh.Vertices,
    Normals=demesh.Normals,
    Mode=Slider(2, range=0..10),
    Alpha=0,
    PoissonDepth=8,
    SamplesPerNode=1.5,
    RadiusRatio=5,
    AFBeta=0.52,
    Run=toggle)  # -> Mesh, UsedMode, Report
remeshgeogram_2 = MeshRemeshGeogram(Mesh=scanrecon_2.Mesh, Points=5000, LloydIters=5, NewtonIters=30, Run=toggle)  # -> Remeshed, Available, Report
quarrydc = QuarryDecompose(Quarry=remeshgeogram_2.Remeshed, NX=4, NY=0, NZ=2, Eps=1e-09)  # -> Slabs, Parents, Mesh
mesh_2 = Mesh(quarrydc.Mesh)
benchfrommesh = BenchFromMesh(Mesh=remeshgeogram_2.Remeshed, BenchHeight=0)  # -> Box, Mesh, BenchBoundary, VertexCount
item = ListItem(List=mesh_2, Index=Slider(1, range=0..10), Wrap=True)
bcosolve = BlockCutOptSolve(
    TestedArea=benchfrommesh.Box,
    Fractures=remeshgeogram_2.Remeshed,
    BlockX=3,
    BlockY=2,
    BlockZ=0.8,
    Kerf=0.05,
    PsiStepDeg=3,
    DxMax=1.5,
    DxStep=0.5,
    DyMax=1.5,
    DyStep=0.5,
    Run=Toggle(True))  # -> NonIntersectedCount, Recovery, BestPsiDeg, BestDxM, BestDyM, Evaluations, ElapsedMs
slabcutcgal = SlabCutByToolMeshCGAL(Slab=benchfrommesh.Box, Mode=2, HybridKernel=True, Run=False)  # -> Outside, Inside, Backend, Available, Report
benchfrommesh_2 = BenchFromMesh(Mesh=remeshgeogram_2.Remeshed, BenchHeight=0)  # -> Box, Mesh, BenchBoundary, VertexCount
recon_u = Panel(scanrecon.UsedMode)
bench_b = Panel(benchfrommesh_2.Box)
bench_m = Panel(benchfrommesh_2.Mesh)
bench_bb = Panel(benchfrommesh_2.BenchBoundary)
recon_r = Panel(scanrecon.Report)
bench_v = Panel(benchfrommesh_2.VertexCount)
