# Grasshopper definition uncertainty_safe_yield.gh (Grasshopper 1.0.8)
# plug-ins: Frahan StonePack

picks = Point([Point(0, 1.015622439, -0.2890625), Point(0, 1.04166404, -0.2890625), Point(0, 1.067705641, -0.2890625), Point(0, 1.093747242, -0.2890625), Point(0, 1.119788843, -0.2890625), Point(0, 1.145830444, -0.2890625)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])
bins = Mesh([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])
gprfrac3d = GPRFractureSurfaces3D(
    FracturePicks=picks,
    NumFractures=-1,
    GridRes=36,
    Velocity=0.1,
    Frequency=600,
    Eps_r=9,
    PermUncertainty=1,
    Tolerance=0.02)  # -> FractureSurfaces, Confidence, MeanSigma, OverallConfidence, Report
fracblockpack = FractureBlockPack(
    ContainerMeshes=bins,
    BlockLength=0.9,
    BlockWidth=0.7,
    BlockHeight=0.4,
    Kerf=0.03,
    FractureClearance=gprfrac3d.MeanSigma,
    Run=True)  # -> Blocks, BinIndex, BlockCount, RecoveredVolume, Yield, Report
overall_confidence = Panel(gprfrac3d.OverallConfidence)
mean_sigma_m = Panel(gprfrac3d.MeanSigma)
block_pack_report = Panel(fracblockpack.Report)
