# Grasshopper definition 10_pack2d_nfp_nest.gh (Grasshopper 1.0.8)
# plug-ins: Frahan StonePack

# ---- group: Frahan 2D Irregular Nesting | V506 (exact-NFP BLF, Burke 2006)
sheetw = Slider(3.2, range=0..5)
sheeth = Slider(2, range=0..5)
spacing = Slider(0.005, range=0..0.05)
sortmode = Slider(1, range=0..4)
tol = Slider(0.001, range=0..0.01)
packseed = Slider(0, range=0..50)
xy = XYPlane(Origin=Point(0, 0, 0))
rectangle = Rectangle(Plane=xy, XSize=sheetw, YSize=sheeth, Radius=0)  # -> Rectangle, Length
freenestx = FreeformSheetNestExactNFP(
    Parts=[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],
    SheetOutlines=rectangle.Rectangle,
    Spacing=spacing,
    Rotations=[0, 90, 180, 270],
    SortMode=sortmode,
    Tolerance=tol,
    Seed=packseed,
    Run=Toggle(True))  # -> PackedCurves, Transforms, SourceIndices, SheetIndices, Unplaced, FailureReasons, SheetPreview, Report

# ----
preview = CustomPreview(
    Geometry=[freenestx.PackedCurves, freenestx.Unplaced, freenestx.SheetPreview],
    Material=ColourSwatch(SwatchColor=RGB(186, 170, 144)))
