# Grasshopper definition 12_trencadis_catalog.gh (Grasshopper 1.0.8)
# plug-ins: Frahan StonePack

# ---- group: Frahan Trencadis Mosaic | Catalog Pack (CVD-Lloyd + Hungarian)
sheetw = Slider(110, range=40..250)
sheeth = Slider(110, range=40..250)
tol = Slider(0.01, range=0.001..0.1)
seed = Slider(3, range=0..50)
lloyd = Slider(12, range=0..40)
grout = Slider(0.4, range=0..2)
xy = XYPlane(Origin=Point(0, 0, 0))
rectangle = Rectangle(Plane=xy, XSize=sheetw, YSize=sheeth, Radius=0)  # -> Rectangle, Length
trencadiscat = FrahanTrencadísCatalogPack(
    Parts=[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],
    SheetOutlines=rectangle.Rectangle,
    Tolerance=tol,
    Seed=seed,
    Run=Toggle(True),
    LloydIterations=lloyd,
    Grout=grout)  # -> PlacedPieces, CellSeeds, SourceIndices, SheetIndices, CellAreas, Report
panel = Panel(trencadiscat.Report)
