# Grasshopper definition 26_loviisa_vector_load.gh (Grasshopper 1.0.8)
# plug-ins: Frahan StonePack

F = F("D:\code_ws\Template-General\raw\2026-05-22\zenodo_loviisa\U-Net_Traces\KB11_2022.shp")
vecfrac = VectorFracturesLoader(FilePath=F)  # -> Traces, Count, CRSWKT, AttributeKeys, AttributeValues, SourceFile
T = Panel(vecfrac.Traces)
N = Panel(vecfrac.Count)
crs = Panel(vecfrac.CRSWKT)
ak = Panel(vecfrac.AttributeKeys)
av = Panel(vecfrac.AttributeValues)
src = Panel(vecfrac.SourceFile)
