# Grasshopper definition fabrication_handoff.gh (Grasshopper 1.0.8)
# plug-ins: Frahan StonePack

discin = DiscontinuityIngest(File="D:\frahan-stonepack\docs\validation\discontinuity_ingest_card\tongjiang_sets.csv", Origin=Point(0, 0, 0))  # -> Planes, Traces, Dip, DipDir, SetId, Report
cutopt = CutOrientation(Dip=discin.Dip, DipDir=discin.DipDir, Bench=True, Center=Point(0, 0, 0), Extent=5)  # -> CutPlanes, CutDip, CutDipDir, FollowsSet, Obliquity, MaxObliquity, Fit, CutRectangles, Report
compas = COMPASExport(
    Blocks=[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],
    Units="m",
    Loader=False,
    FilePath="D:\frahan-stonepack\examples\47_fabrication_handoff\assembly_compas.json",
    Write=False)  # -> FilePath, Loader, Blocks, Frames, Report
wiresaw = WireSawFeasibility(Surface=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, WireDia=0.003, Vibration=0.0005, Tolerance=0.005, Samples=12)  # -> WireSawable, Ruled, Developable, Planar, MaxGaussian, RulingDev, Twist, Kerf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
dxfcut = DXFCutPlan(
    Curves=cutopt.CutRectangles,
    FlattenNest=True,
    Gap=0.1,
    SheetWidth=0,
    TextHeight=0,
    FilePath="D:\frahan-stonepack\examples\47_fabrication_handoff\cutplan.dxf",
    Write=False)  # -> FilePath, Count, Layout, Report
